# Grasshopper definition TestGraph.gh (Grasshopper 1.0.8)
# plug-ins: jSwan, Karamba3D, Pufferfish, Human, Glab

point = Point(<point referenced from the Rhino model>)
curve = Curve([<curve referenced from the Rhino model> x3])
curve_2 = Curve(<curve referenced from the Rhino model>)
point_2 = Point(<point referenced from the Rhino model>)
curve_3 = Curve([<curve referenced from the Rhino model> x5])
curve_4 = Curve([<curve referenced from the Rhino model> x2])
point_3 = Point(<point referenced from the Rhino model>)
curve_5 = Curve(<curve referenced from the Rhino model>)
skeletonizeboundary = SkeletonizeBoundary(BoundaryCurve=curve_2, DivisionLength=Slider(5, range=0..10))  # -> SkeletonCurves, SkeletonGraphs
serialize_keys_and_values = SerializeKeysAndValues(Key="KeyNode", Value="NodeAttribute")
construct_node = ConstructNode(Points=point_2)
construct_edge = ConstructEdge(Curves=curve_3)
construct_node_2 = ConstructNode(Points=point_3)
construct_edge_2 = ConstructEdge(Curves=curve_4)
construct_edge_3 = ConstructEdge(Curves=curve_5)
number_slider = Slider(4, range=0..10)
construct_node_3 = ConstructNode(Points=point, Attributes=serialize_keys_and_values)
serialize_keys_and_values_2 = SerializeKeysAndValues(Key="Test", Value="Test")
serialize_keys_and_values_3 = SerializeKeysAndValues(Key="EdgeKey", Value="EdgeAttribute")
construct_edge_4 = ConstructEdge(Curves=curve, Attributes=serialize_keys_and_values_3)
point_4 = Point([<point referenced from the Rhino model> x2])
constructgraph = ConstructGraph(Nodes=construct_node, Edges=construct_edge, ShatterEdge=True)  # -> Graphs, IsolatedNodes, IsolatedEdges
construct_graph = ConstructGraph(Edges=construct_edge_2, ShatterEdge=True)  # -> Graphs, IsolatedNodes, IsolatedEdges
construct_graph_2 = ConstructGraph(Nodes=construct_node_2, Edges=construct_edge_3, ShatterEdge=True)  # -> Graphs, IsolatedNodes, IsolatedEdges
point_5 = Point(<point referenced from the Rhino model>)
brep = Brep(<brep referenced from the Rhino model>)
curve_6 = Curve(<curve referenced from the Rhino model>)
curve_7 = Curve(<curve referenced from the Rhino model>)
brep_2 = Brep(<brep referenced from the Rhino model>)
brep_3 = Brep(<brep referenced from the Rhino model>)
integer = Integer(Slider(1, range=0..10))
serialize_keys_and_values_4 = SerializeKeysAndValues(Key="Valence", Value=integer)
point_6 = Point([<point referenced from the Rhino model> x2])
rectangular = Rectangular(Plane=PlaneXY(66.08815088, 13.28184015, 0), SizeX=number_slider, SizeY=number_slider, ExtentX=10, ExtentY=5)  # -> Cells, Points
explode = Explode(Curve=flatten(rectangular.Cells), Recursive=True)  # -> Segments, Vertices
remove_duplicate_lines_karamba3d = RemoveDuplicateLinesKaramba3D(Line=flatten(explode.Segments), LimitDistance=0.005)  # -> OutLine, Info, Indexes
construct_edge_5 = ConstructEdge(Curves=remove_duplicate_lines_karamba3d.OutLine)
construct_node_4 = ConstructNode(Points=point_4, Attributes=serialize_keys_and_values_2)
deconstruct_node = DeconstructNode(Node=construct_node_3)  # -> Attributes, Point, LinkedObjects
panel = Panel(deconstruct_node.Attributes)
panel_2 = Panel(serialize_keys_and_values_4)
construct_node_5 = ConstructNode(Points=point_5, LinkedObjects=brep)
construct_edge_6 = ConstructEdge(Curves=curve_7, LinkedObjects=brep_2)
construct_edge_7 = ConstructEdge(Curves=curve_6, LinkedObjects=brep_3)
point_7 = Point(<point referenced from the Rhino model>)
point_8 = Point(<point referenced from the Rhino model>)
modifygraphnode = ModifyGraphNode(Graphs=skeletonizeboundary.SkeletonGraphs, Points=point_6, Type="NoPrune")  # -> UpdatedGraphs, UpdatedNodes
constructgraph_2 = ConstructGraph(Nodes=construct_node_3, Edges=construct_edge_4, ShatterEdge=True)  # -> Graphs, IsolatedNodes, IsolatedEdges
list_item = ListItem(List=constructgraph.Graphs, Index=0, Wrap=True)
construct_graph_3 = ConstructGraph(Edges=construct_edge_5, ShatterEdge=True)  # -> Graphs, IsolatedNodes, IsolatedEdges
point_9 = Point(<point referenced from the Rhino model>)
filternodeandedge = FilterNodeAndEdge(Graphs=modifygraphnode.UpdatedGraphs, Type="NoPrune", Attributes=panel_2)  # -> FilteredNodes, FilteredEdges
find_modify_graph_node = FindModifyGraphNode(Graphs=construct_graph_3.Graphs, Points=[point_8, point_7])  # -> UpdatedGraphs, UpdatedNodes
deconstructgraph = DeconstructGraph(Graph=list_item)  # -> Attributes, Nodes, Edges
construct_graph_4 = ConstructGraph(Nodes=construct_node_5, Edges=[construct_edge_6, construct_edge_7], ShatterEdge=True)  # -> Graphs, IsolatedNodes, IsolatedEdges
find_closest_graph = FindClosestGraph(Graphs=[construct_graph.Graphs, construct_graph_2.Graphs], TestPoints=point_9)  # -> ClosestGraphs, Distances
connect_node_to_graph = ConnectNodeToGraph(Graphs=construct_graph_2.Graphs, Nodes=construct_node_4)
constructgraph_3 = ConstructGraph(Edges=construct_edge_4, ShatterEdge=True)  # -> Graphs, IsolatedNodes, IsolatedEdges
serialize_keys_and_values_5 = SerializeKeysAndValues(Key="KeyTest", Value="ValueTest")
prune_graph_node = PruneGraphNode(Graphs=modifygraphnode.UpdatedGraphs, ValenceToPrune=1, TypeToExclude="NoPrune", PruneTypeNullOnly=True)
simplify_graph = SimplifyGraph(Graphs=prune_graph_node, MinAngle=160, MaxAngle=180, CollapseShortEdges=invert(False), MinLength=Slider(2, range=0..10))
longest_list = LongestList(ListListA=constructgraph_2.Graphs, ListListB=serialize_keys_and_values_5, PaddingMode=2)  # -> ListListA, ListListB
deconstructnode = DeconstructNode(Node=filternodeandedge.FilteredNodes)  # -> Attributes, Point, LinkedObjects
deconstruct_node_2 = DeconstructNode(Node=deconstructgraph.Nodes)  # -> Attributes, Point, LinkedObjects
list_item_2 = ListItem(List=find_modify_graph_node.UpdatedNodes, Index=0, Wrap=True)  # -> Item, Item1
point_10 = Point([<point referenced from the Rhino model> x2])
export_graph_to_json = ExportGraphToJSON(
    Graph=[construct_graph.Graphs, construct_graph_2.Graphs],
    FilePath="E:\Desktop\Graph.JSON",
    IncludeGeometry=True,
    Export=Button())
deconstruct_graph = DeconstructGraph(Graph=construct_graph_4.Graphs)  # -> Attributes, Nodes, Edges
visualize_graph = VisualizeGraph(
    Graphs=connect_node_to_graph,
    PreviewColor=RGB(0, 0, 0),
    ShowNodeValence=invert(True),
    ShowEdgeValence=invert(False),
    ShowNodeAttribute=invert(False))
visualize_graph_2 = VisualizeGraph(
    Graphs=find_closest_graph.ClosestGraphs,
    PreviewColor=RGB(0, 0, 0),
    ShowNodeValence=True,
    ShowEdgeValence=False,
    ShowNodeAttribute=False)
deconstruct_graph_2 = DeconstructGraph(Graph=connect_node_to_graph)  # -> Attributes, Nodes, Edges
modifygraphelement = ModifyGraphElement(Graph=longest_list.ListListA, Attributes=longest_list.ListListB)
find_shortest_path = FindShortestPath(Graphs=construct_graph_3.Graphs, StartNodes=list_item_2.Item, EndNodes=list_item_2.Item1)  # -> PathNodes, PathEdges, PathLength
panel_3 = Panel(find_shortest_path.PathLength)
deconstructgraph_2 = DeconstructGraph(Graph=constructgraph_2.Graphs)  # -> Attributes, Nodes, Edges
panel_4 = Panel(deconstructgraph_2.Attributes)
serialize_keys_and_values_6 = SerializeKeysAndValues(Key="KeyNode2", Value="NodeAttribute2")
panel_5 = Panel(deconstructnode.Attributes)
panel_6 = Panel(export_graph_to_json)
deconstruct_edge = DeconstructEdge(Edge=deconstruct_graph.Edges)  # -> Attributes, SourceNode, TargetNode, Geometry, LinkedObjects
deconstruct_node_3 = DeconstructNode(Node=deconstruct_graph.Nodes)  # -> Attributes, Point, LinkedObjects
visualize_graph_3 = VisualizeGraph(Graphs=simplify_graph, PreviewColor=RGB(0, 0, 0), ShowNodeValence=True, ShowEdgeValence=False, ShowNodeAttribute=False)
deconstruct_edge_2 = DeconstructEdge(Edge=find_shortest_path.PathEdges)  # -> Attributes, SourceNode, TargetNode, Geometry, LinkedObjects
deconstruct_node_4 = DeconstructNode(Node=deconstruct_graph_2.Nodes)  # -> Attributes, Point, LinkedObjects
deconstruct = Deconstruct(Point=deconstruct_node_4.Point)  # -> XComponent, YComponent, ZComponent
findnodebypoint = FindNodeByPoint(Graphs=constructgraph_3.Graphs, Points=point_10, Type="A", Attributes=serialize_keys_and_values_6)  # -> UpdatedGraphs, Nodes
deconstruct_node_5 = DeconstructNode(Node=findnodebypoint.Nodes)  # -> Attributes, Point, LinkedObjects
panel_7 = Panel(deconstruct_graph_2.Attributes)
deconstructgraph_3 = DeconstructGraph(Graph=modifygraphelement)  # -> Attributes, Nodes, Edges
panel_8 = Panel(deconstructgraph_3.Attributes)
round_to_decimal_place = RoundToDecimalPlace(NumberX=deconstruct.XComponent, DecimalPlace="2", RoundType=0)  # -> Rounded, Difference
round_to_decimal_place_2 = RoundToDecimalPlace(NumberX=deconstruct.YComponent, DecimalPlace="2", RoundType=0)  # -> Rounded, Difference
point_11 = Point(<point referenced from the Rhino model>)

deconstructgraph_4 = DeconstructGraph(Graph=simplify_graph)  # -> Attributes, Nodes, Edges
panel_9 = Panel(deconstructgraph_4.Attributes)
deconstructnode_2 = DeconstructNode(Node=deconstructgraph_4.Nodes)  # -> Attributes, Point, LinkedObjects
deconstructedge = DeconstructEdge(Edge=deconstructgraph_4.Edges)  # -> Attributes, SourceNode, TargetNode, Geometry, LinkedObjects
panel_10 = Panel(deconstructedge.Attributes)
panel_11 = Panel(deconstructnode_2.Attributes)

panel_12 = Panel(deconstruct_node_4.Attributes)
panel_13 = Panel(deconstruct_node_5.Attributes)
panel_14 = Panel(deconstruct_edge_2.Attributes)
custom_preview_lineweights = CustomPreviewLineweights(
    Geometry=deconstruct_edge_2.Geometry,
    Shader={diffuse=RGB(255, 105, 180), emission=RGB(76, 32, 54), shine=0.5, specular=RGB(255, 255, 255), transparency=0},
    Thickness=Slider(7, range=0..10),
    Absolute=False)
curve_8 = Curve(<curve referenced from the Rhino model>)
concatenate = Concatenate(Fragment_A=round_to_decimal_place.Rounded, A="----", Fragment_B=round_to_decimal_place_2.Rounded)
merge = Merge(Data1=modifygraphelement, Data2=findnodebypoint.UpdatedGraphs)
findnodebypoint_2 = FindNodeByPoint(Graphs=modifygraphelement, Points=point_11, Type="B")  # -> UpdatedGraphs, Nodes
deconstruct_node_6 = DeconstructNode(Node=deconstructgraph_3.Nodes)  # -> Attributes, Point, LinkedObjects
deconstruct_edge_3 = DeconstructEdge(Edge=deconstructgraph_3.Edges)  # -> Attributes, SourceNode, TargetNode, Geometry, LinkedObjects
serialize_keys_and_values_7 = SerializeKeysAndValues(Key="KeyTest", Value="ValueTest")
findedgebyline = FindEdgeByLine(Graphs=findnodebypoint_2.UpdatedGraphs, Lines=curve_8, Type="C", Attributes=serialize_keys_and_values_7)  # -> UpdatedGraphs, Edges
text_tag = TextTag(Location=deconstruct_node_4.Point, Text=concatenate)
mergegraphs = MergeGraphs(Graphs=flatten(merge))
deconstruct_edge_4 = DeconstructEdge(Edge=findedgebyline.Edges)  # -> Attributes, SourceNode, TargetNode, Geometry, LinkedObjects
panel_15 = Panel(deconstruct_edge_3.Attributes)
panel_16 = Panel(deconstruct_node_6.Attributes)
deconstructgraph_5 = DeconstructGraph(Graph=mergegraphs)  # -> Attributes, Nodes, Edges
splitgraphatpoint = SplitGraphAtPoint(Graphs=findedgebyline.UpdatedGraphs, Points=point_11)
panel_17 = Panel(deconstruct_edge_4.Attributes)
deserialize_json = DeserializeJson(JSON=deconstruct_edge_4.Attributes, OutputsLocked=False)  # -> EdgeKey, Id, Length, Type, Valence, IsInGraph, GGUID, KeyTest
panel_18 = Panel(deconstructgraph_5.Attributes)
list_item_3 = ListItem(List=splitgraphatpoint, Index=Slider(1, range=0..10), Wrap=True)
deconstruct_node_7 = DeconstructNode(Node=deconstructgraph_5.Nodes)  # -> Attributes, Point, LinkedObjects
integer_2 = Integer(Slider(1, range=0..10))
panel_19 = Panel(deconstruct_node_7.Attributes)
filternodeandedge_2 = FilterNodeAndEdge(Graphs=list_item_3, Type="C")  # -> FilteredNodes, FilteredEdges
serialize_keys_and_values_8 = SerializeKeysAndValues(Key="Valence", Value=integer_2)
visualize_graph_4 = VisualizeGraph(Graphs=list_item_3, PreviewColor=RGB(0, 0, 0), ShowNodeValence=True, ShowEdgeValence=False, ShowNodeAttribute=False)
panel_20 = Panel(serialize_keys_and_values_8)
deconstruct_edge_5 = DeconstructEdge(Edge=filternodeandedge_2.FilteredEdges)  # -> Attributes, SourceNode, TargetNode, Geometry, LinkedObjects
filternodeandedge_3 = FilterNodeAndEdge(Graphs=list_item_3, Attributes=panel_20)  # -> FilteredNodes, FilteredEdges
panel_21 = Panel(deconstruct_edge_5.Attributes)
deconstruct_node_8 = DeconstructNode(Node=filternodeandedge_3.FilteredNodes)  # -> Attributes, Point, LinkedObjects
panel_22 = Panel(deconstruct_node_8.Attributes)
